# Grasshopper definition flockingTest.gh (Grasshopper 0.9.75)
# plug-ins: Agent

number_slider = Slider(30, range=0..100)
number_slider_2 = Slider(2, range=0..10)
box = CenterBox(Base=PlaneXY(0, 0, 0), X=number_slider, Y=number_slider, Z=Slider(15, range=0..100))
wires = BrepWireframe(Brep=box, Density=-1)  # disabled
particle = ConstructParticle(
    MinimumInitialVelocity=Vector(-0.1, -0.1, -0.1),
    MaximumInitialVelocity=Vector(0.1, 0.1, 0.1),
    Acceleration=Vector(0, 0, 0),
    Lifespan=Slider(-1, range=-1..1000),
    Mass=1,
    BodySize=1,
    HistoryLength=1)
aaboxenv = AxisAlignedBoxEnvironment(Box=box)
agent = ConstructAgent(
    Particle=particle,
    MaxSpeed=Slider(1, range=0..1),
    MaxForce=Slider(0.15, range=0..1),
    VisionRadius=Slider(10, range=0..10),
    VisionAngle=360)
boxemit = BoxEmitter(ContinuousFlow=Toggle(False), CreationRate=1, NumberOfQuelea=Slider(300, range=0..1000), Box=box)
brep = Brep(<brep referenced from the Rhino model>)  # disabled
system = System(Quelea=agent, Emitters=boxemit)  # -> System, Quelea, QueleaNetwork
timer = Timer(TimerInterval=20, Target=[engine, system])  # disabled
avoidobstacle = AvoidObstacleForce(Apply=True, WeightMultiplier=1, Agent=system.Quelea, Obstacle=brep, VisionRadiusMutliplier=0.2)  # -> Force, DesiredVelocity; disabled
engine = Engine(Reset=Toggle(True), System=system.System)
neighbors = GetNeighborsInRadius(Agent=system.Quelea, QueleaNetwork=system.QueleaNetwork, VisionRadiusMultiplier=1, VisionAngleMultiplier=1)
neighbors_2 = GetNeighborsInRadius(Agent=system.Quelea, QueleaNetwork=neighbors, VisionRadiusMultiplier=Slider(0.667, range=0..1), VisionAngleMultiplier=1)
neighbors_3 = GetNeighborsInRadius(
    Agent=system.Quelea,
    QueleaNetwork=neighbors_2,
    VisionRadiusMultiplier=Slider(0.333, range=0..1),
    VisionAngleMultiplier=1)
contain = ContainForce(Apply=True, WeightMultiplier=1, Agent=system.Quelea, Environment=aaboxenv, VisionRadiusMutliplier=0.2)  # -> Force, DesiredVelocity
departicle = DeconstructParticle(Particle=system.Quelea)  # -> Position, Velocity, Acceleration, Lifespan, SurfacePosition, SurfaceVelocity, SurfaceAcceleration
pt = Point(departicle.Position)
item = ListItem(List=pt, Index=0, Wrap=True)  # -> flatten(Item)
pt_2 = Point(departicle.SurfacePosition)
cohese = CoheseForce(Apply=True, WeightMultiplier=1, Agent=system.Quelea, GetNeighborsInRadius=neighbors)  # -> Force, DesiredVelocity
align = AlignForce(Apply=True, WeightMultiplier=1, Agent=system.Quelea, GetNeighborsInRadius=neighbors_2)  # -> Force, DesiredVelocity
separate = SeparateForce(Apply=True, WeightMultiplier=Slider(1, range=0..1), Agent=system.Quelea, GetNeighborsInRadius=neighbors_3)  # -> Force, DesiredVelocity
vdis = VectorDisplay(Anchor=item, Vector=departicle.Velocity)
vdis_2 = VectorDisplay(Anchor=pt_2)
vdis_3 = VectorDisplay(Anchor=pt_2)  # disabled
wander = WanderForce(Apply=True, WeightMultiplier=1, Agent=system.Quelea, Strength=Slider(0.25, range=0..1), Rate=Slider(0.25, range=0..1))  # -> Force, DesiredVelocity, Sphere, TargetPoint
