# Grasshopper definition polymorphicTypeTest.gh (Grasshopper 0.9.75)
# plug-ins: Agent

particle = ConstructParticle(
    MinimumInitialVelocity=Vector(-0.1, -0.1, -0.1),
    MaximumInitialVelocity=Vector(0.1, 0.1, 0.1),
    Acceleration=Vector(0, 0, 0),
    Lifespan=30,
    Mass=1,
    BodySize=1,
    HistoryLength=1)
agent = ConstructAgent(Particle=particle, MaxSpeed=0.5, MaxForce=0.1, VisionRadius=5, VisionAngle=360)
ptemit = PointEmitter(ContinuousFlow=True, CreationRate=1, NumberOfQuelea=0, Point=Point(0, 0, 0))
system = System(Quelea=agent, Emitters=ptemit)
deconstructsystem = DeconstructSystem(System=system)  # -> Agents, QueleaNetwork
deconstructqn = DeconstructQueleaNetwork(QueleaNetwork=deconstructsystem.QueleaNetwork)
engine = Engine(Reset=True, System=system)
