# Grasshopper definition test.gh (Grasshopper 0.9.75)
# plug-ins: Agent

pt = Point(<point referenced from the Rhino model>)
box = DomainBox(Base=pt, X=Slider(10, range=0..10), Y=Slider(10, range=0..10), Z=Slider(10, range=0..10))
pemit = PointEmitter(Point=<geometry referenced from the Rhino model>, ContinuousFlow=True, CreationRate=1, NumberOfAgents=0)
agent = Agent(
    Lifespan=30,
    Mass=1,
    BodySize=1,
    MaximumSpeed=0.5,
    MaximumForce=0.1,
    VisionAngle=15,
    VisionRadius=5,
    LengthOfPositionHistory=1)
wboxenv = WorldBoxEnvironment(Box=box)
srfenv = SurfaceEnvironment()
system = AgentSystem(Agents=agent, Emitters=pemit, Environment=wboxenv)
timer = Timer(TimerInterval=20, Target=engine)
engine = Engine(Reset=Toggle(False), LiveUpdate=True, Systems=system)
deconstructagent = DeconstructAgent(Agent=engine)  # -> Position, Velocity, Acceleration, Lifespan
