# Grasshopper definition vehicle.gh (Grasshopper 0.9.75)
# plug-ins: Agent

particle = ConstructParticle(
    MinimumInitialVelocity=Vector(-0.1, -0.1, -0.1),
    MaximumInitialVelocity=Vector(0.1, 0.1, 0.1),
    Acceleration=Vector(0, 0, 0),
    Lifespan=Slider(150, range=0..1000),
    Mass=1,
    BodySize=1,
    HistoryLength=1)
pt = Point(<point referenced from the Rhino model>)
pt_2 = Point(<point referenced from the Rhino model>)
agent = ConstructAgent(Particle=particle, MaxSpeed=0.5, MaxForce=0.1, VisionRadius=5, VisionAngle=360)
xy = XYPlane(Origin=Point(0, 0, 0))
vec2pt = Vector2Pt(PointA=pt_2, PointB=pt, Unitize=False)  # -> Vector, Length
ptemit = PointEmitter(ContinuousFlow=True, CreationRate=1, NumberOfQuelea=0, Point=Point(0, 0, 0))
vehicle = ConstructVehicle(Agent=agent, Orientation=PlaneXY(0, 0, 0), WheelRadius=1)
vdis = VectorDisplay(Anchor=pt_2, Vector=vec2pt.Vector)
c_script = CSharpScript(position=pt_2, velocity=vec2pt.Vector, bodySize=Slider(1, range=0..10), orientation=xy)  # -> out, A, B, C; inputs position: Point3d, velocity: Vector3d, bodySize: Double, orientation: Plane
# ---------- c_script: C# ----------
    double halfBodySize = bodySize / 2;
    double halfPi = Math.PI / 2;

    Vector3d wheelLeftVec = velocity;
    Vector3d wheelRightVec = velocity;
    wheelLeftVec.Rotate(halfPi, orientation.ZAxis);
    wheelRightVec.Rotate(-halfPi, orientation.ZAxis);
    wheelLeftVec.Unitize();
    wheelRightVec.Unitize();
    wheelLeftVec = Vector3d.Multiply(wheelLeftVec, halfBodySize);
    wheelRightVec = Vector3d.Multiply(wheelRightVec, halfBodySize);
    A = wheelLeftVec;
    B = wheelRightVec;
    double angle = Vector3d.VectorAngle(Vector3d.XAxis, velocity);


    double wheelLeftX = position.X + halfBodySize * Math.Cos(angle - halfPi);
    double wheelLeftY = position.Y + halfBodySize * Math.Sin(angle - halfPi);

    double wheelRightX = position.X + halfBodySize * Math.Cos(angle + halfPi);
    double wheelRightY = position.Y + halfBodySize * Math.Sin(angle + halfPi);
    //A = new Point3d(wheelLeftX, wheelLeftY, 0);
    //B = new Point3d(wheelRightX, wheelRightY, 0);
    C = angle;
# ---------- end c_script ----------
timer = Timer(TimerInterval=20, Target=[engine, system])
system = System(Quelea=vehicle, Emitters=ptemit)
vdis_2 = VectorDisplay(Anchor=pt_2, Vector=c_script.A)
vdis_3 = VectorDisplay(Anchor=pt_2, Vector=c_script.B)
desystem = DeconstructSystem(System=system)  # -> Quelea, QueleaNetwork
engine = Engine(Reset=Toggle(True), System=system)
dequelea = DeconstructQuelea(Quelea=desystem.Quelea)  # -> Position, Velocity, Acceleration, Lifespan, ReferencePosition
